# Grasshopper definition Object Oriented Bilayers.gh (Grasshopper 1.0.7)
# plug-ins: sof_gh_sofistik-2022, HygroDesign

io = IO(
    SofistikDocumentProperties_VersionMajor="2022",
    SofistikDocumentProperties_VersionMinor="0",
    SofistikDocumentProperties_VersionName="2022")
number_slider = Slider(1000, range=0..1000)
xy = XYPlane(Origin=Point(0, 0, 0))
panel = BilayerPanel(
    BasePlane=xy,
    BoardWidth=Slider(100, range=0..100),
    BoardLength=number_slider,
    WidthCount=Slider(9, range=0..10),
    LengthCount=Slider(4, range=0..10))
board_count = Slider(100, range=0..100)
deconstruct_panel = DeconstructPanel(Panel=panel)
species = WoodSpecies()
item = ListItem(List=species, Index=0, Wrap=True)  # -> Item, Item1
dec_board = DeconstructBoard(Board=deconstruct_panel)  # -> Name, Polyline, Radius, MoistureChange, Error

# ---- group: spruce
data = Data(item.Item1)

# ---- group: beech
data_2 = Data(item.Item)

# ----
area = Area(Geometry=dec_board.Polyline)  # -> Area, Centroid

# ---- group: desired radius
pt = Point(area.Centroid)
pdecon = Deconstruct(Point=pt)  # -> XComponent, YComponent, ZComponent
bnd = Bounds(Numbers=flatten(pdecon.XComponent))
dom = ConstructDomain(DomainStart=Slider(253, range=0..1000), DomainEnd=Slider(1242, range=0..10000))
remap = RemapNumbers(Value=pdecon.XComponent, Source=bnd, Target=dom)  # -> Mapped, Clipped

# ---- group: calculate weights
pt_2 = Point(area.Centroid)
avr = Average(Input=flatten(pt_2))
pdecon_2 = Deconstruct(Point=pt_2)  # -> XComponent, YComponent, ZComponent
pdecon_3 = Deconstruct(Point=avr)  # -> XComponent, YComponent, ZComponent
subtraction = Subtraction(A=pdecon_2.XComponent, B=pdecon_3.XComponent)
abs = Absolute(Value=subtraction)
bnd_2 = Bounds(Numbers=flatten(abs))
dom_2 = ConstructDomain(DomainStart=Slider(0, range=0..1000), DomainEnd=Slider(1, range=0..10))
remap_2 = RemapNumbers(Value=abs, Source=bnd_2, Target=dom_2)  # -> Mapped, Clipped

# ---- group: material goals / beech
data_3 = Data(data_2)

# ---- group: material goals / spruce
data_4 = Data(data)

# ---- group: material goals
pt_3 = Point(area.Centroid)
pdecon_4 = Deconstruct(Point=pt_3)  # -> XComponent, YComponent, ZComponent
avr_2 = Average(Input=flatten(pdecon_4.XComponent))
smaller = SmallerThan(FirstNumber=pdecon_4.XComponent, SecondNumber=avr_2)  # -> SmallerThan, OrEqualTo
lng = ListLength(List=flatten(smaller.SmallerThan))
lng_2 = ListLength(List=smaller.SmallerThan)  # -> flatten(Length)
dup = DuplicateData(Data=data_4, Number=lng, Order=True)
dup_2 = DuplicateData(Data=data_3, Number=lng, Order=True)
partition = PartitionList(List=dup, Size=lng_2)  # -> simplify(Chunks)
partition_2 = PartitionList(List=dup_2, Size=lng_2)  # -> simplify(Chunks)
not = GateNot(A=smaller.SmallerThan)
cull = CullPattern(List=partition, CullPattern=not)
cull_2 = CullPattern(List=partition_2, CullPattern=smaller.SmallerThan)
merge = Merge(Data1=cull_2, Data2=cull)

# ---- group: name
num = Number(board_count)
series = Series(Start=0, Step=1, Count=num)
dup_3 = DuplicateData(Data="S", Number=num, Order=True)  # -> graft(Data)
txt = Text(graft(series))
merge_2 = Merge(Data1=dup_3, Data2=txt)  # -> simplify(Result)
join = TextJoin(Text=merge_2)  # -> flatten(Result)

# ---- group: RT
dom_3 = ConstructDomain(DomainStart=Slider(11, range=0..100), DomainEnd=Slider(75, range=0..100))
random = Random(Range=dom_3, Number=board_count, Seed=Slider(225, range=0..1000))

dom_4 = ConstructDomain(DomainStart=Slider(15, range=0..100), DomainEnd=Slider(75, range=0..100))
random_2 = Random(Range=dom_4, Number=board_count, Seed=Slider(225, range=0..1000))

# ---- group: name
num_2 = Number(board_count)
series_2 = Series(Start=0, Step=1, Count=num_2)
dup_4 = DuplicateData(Data="B", Number=num_2, Order=True)  # -> graft(Data)
txt_2 = Text(graft(series_2))
merge_3 = Merge(Data1=dup_4, Data2=txt_2)  # -> simplify(Result)
join_2 = TextJoin(Text=merge_3)  # -> flatten(Result)

# ---- group: length
num_3 = Number(number_slider)
num_4 = Number(board_count)
dup_5 = DuplicateData(Data=num_3, Number=num_4, Order=True)

num_5 = Number(number_slider)
num_6 = Number(board_count)
dup_6 = DuplicateData(Data=num_5, Number=num_6, Order=True)

# ---- group: moisture changes
panel_2 = Panel("""5
10
15""")
num_7 = Number(panel_2)

# ----
stockpile = Stockpile(Material=data, Name=join, Length=dup_6, RTAngle=random_2, MoistureChanges=num_7)
stockpile_2 = Stockpile(Material=data_2, Name=join_2, Length=dup_5, RTAngle=random, MoistureChanges=num_7)
board_goals = SetBoardGoals(Board=deconstruct_panel, Radius=remap.Mapped, RadiusWeight=remap_2.Mapped, Material=merge, MaterialWeight=remap_2.Mapped)
merge_4 = Merge(Data1=stockpile_2, Data2=stockpile)
update_panel = UpdatePanel(Panel=panel, Boards=board_goals)
design_env = DesignEnvironment(Panels=update_panel, Stockpile=merge_4)
deconstruct_panel_2 = DeconstructPanel(Panel=design_env)
dec_board_2 = DeconstructBoard(Board=deconstruct_panel_2)  # -> Name, Polyline, Radius, MoistureChange, Error
bnd_3 = Bounds(Numbers=flatten(dec_board_2.Radius))
srf = Surface(dec_board_2.Polyline)
dedomain = DeconstructDomain(Domain=bnd_3)  # -> Start, End
gradient = Gradient(
    LowerLimit=dedomain.Start,
    UpperLimit=dedomain.End,
    Parameter=dec_board_2.Radius,
    stops=[0: RGB(0, 128, 0), 0.5: RGB(255, 255, 0), 1: RGB(255, 0, 0)])
preview = CustomPreview(Geometry=srf, Material=gradient)
